# Grasshopper definition 190612_camera position estimation.gh (Grasshopper 0.9.76)
# plug-ins: horsterCameraControl

# ---- group: pic pixel w
panel = Panel("1920")

# ---- group: pic pixel h
panel_2 = Panel("1080")

# ----
panel_3 = Panel("-0.02648576986918466,0.9685222924365495,0.24751378355131548")  # disabled
panel_4 = Panel("5424.463475908621, 1785.3605236576707, 0.0")  # disabled
panel_5 = Panel("0.6679234124293224,0.7439359661251366,0.020918734049383145")  # disabled
panel_6 = Panel("-0.02648576986918466,0.6131360169810582,0.7895332346868242")  # disabled
panel_7 = Panel("2331.6014406038503, 1749.7639864362293, 0.0")  # disabled
panel_8 = Panel("-149.0739561034161, 533.1927894644232, 0.0")  # disabled
panel_9 = Panel("5346.334096238496, 568.2270716976934, 0.0")  # disabled
panel_10 = Panel("-901.098889123094, -1593.8758171858883, 2631.9404691862087")  # disabled

# ---- group: 4 world pts
pt = Point([<point referenced from the Rhino model> x4])

# ---- group: tvec
panel_11 = Panel("-743.92286452,1017.57516516,3004.51069946")

# ---- group: pic origin pt
pt_2 = Point(<point referenced from the Rhino model>)

# ---- group: rvec
panel_12 = Panel("-2.23351326,0.4190061,-1.12244799")

# ---- group: pic bound pt
pt_3 = Point(<point referenced from the Rhino model>)

# ---- group: 4 pic pts
pt_4 = Point([<point referenced from the Rhino model> x4])

# ---- group: cam to obj pos
panel_13 = Panel("6230.89935992,-1183.72224833,2889.16654754")  # disabled

# ---- group: cam to obj rot euler
panel_14 = Panel("-2.23126297,-0.02092026,0.83918485")  # disabled

# ----
pdecon = Deconstruct(Point=pt)  # -> XComponent, YComponent, ZComponent
# Yan Zhang (Ryan) <ryanz@mit.edu>
# City Science Group, MIT Media Lab
# July. 2019
# camera position estimation
# Python OpenCV Solution (with .py file)
panel_15 = Panel("0,0,0")  # disabled
panel_16 = Panel("1,0,0")  # disabled
pdecon_2 = Deconstruct(Point=pt_3)  # -> XComponent, YComponent, ZComponent
pdecon_3 = Deconstruct(Point=pt_4)  # -> XComponent, YComponent, ZComponent
pdecon_4 = Deconstruct(Point=pt_2)  # -> XComponent, YComponent, ZComponent
panel_17 = Panel("-90")  # disabled
ln = Line(StartPoint=panel_15, EndPoint=panel_16)  # disabled
rotax = RotateAxis(Geometry=pt, Angle=degrees(panel_17), Axis=ln)  # -> Geometry, Transform; disabled
panel_18 = Panel("1000")  # disabled
panel_19 = Panel("-1000")  # disabled
Z = UnitZ(Factor=1)  # disabled
eval = Evaluate(F="(1-(y-y1)/(y2-y1))*h", y1=pdecon_4.YComponent, y2=pdecon_2.YComponent, y=pdecon_3.YComponent, h=panel_2)
Y = UnitY(Factor=1)  # disabled
eval_2 = Evaluate(F="(x-x1)/(x2-x1)*w", x1=pdecon_4.XComponent, x2=pdecon_2.XComponent, x=pdecon_3.XComponent, w=panel)

# ---- group: camera taget line
line = LineSDL(Start=Point(0, 0, 0), Direction=Z, Length=panel_18)  # disabled

# ---- group: camera up line
line_2 = LineSDL(Start=Point(0, 0, 0), Direction=Y, Length=panel_19)  # disabled

# ---- group: pic pixel pts
pt_5 = ConstructPoint(XCoordinate=eval_2, YCoordinate=eval, ZCoordinate=pdecon_4.ZComponent)

# ----
pt_6 = Point(panel_11)

# ---- group: obj pts
pt_7 = ConstructPoint(XCoordinate=pdecon.XComponent, YCoordinate=pdecon.YComponent, ZCoordinate=pdecon.ZComponent)

# ----
pdecon_5 = Deconstruct(Point=panel_14)  # -> XComponent, YComponent, ZComponent; disabled
pt_8 = Point(panel_13)  # disabled
vec = Vector(panel_12)
X = UnitX(Factor=1)  # disabled
rot3d = Rotate3D(Geometry=line_2, Angle=pdecon_5.XComponent, Center=Point(0, 0, 0), Axis=X)  # -> Geometry, Transform; disabled
X_2 = UnitX(Factor=1)  # disabled
rot3d_2 = Rotate3D(Geometry=line, Angle=pdecon_5.XComponent, Center=Point(0, 0, 0), Axis=X_2)  # -> Geometry, Transform; disabled
panel_20 = Panel(pt_5)
panel_21 = Panel(pt_7)
Y_2 = UnitY(Factor=1)  # disabled
rot3d_3 = Rotate3D(Geometry=rot3d.Geometry, Angle=pdecon_5.YComponent, Center=Point(0, 0, 0), Axis=Y_2)  # -> Geometry, Transform; disabled
Y_3 = UnitY(Factor=1)  # disabled
rot3d_4 = Rotate3D(Geometry=rot3d_2.Geometry, Angle=pdecon_5.YComponent, Center=Point(0, 0, 0), Axis=Y_3)  # -> Geometry, Transform; disabled
ln_2 = Line(StartPoint="0,0,0", EndPoint="1,0,0")
Z_2 = UnitZ(Factor=1)  # disabled
rot3d_5 = Rotate3D(Geometry=rot3d_3.Geometry, Angle=pdecon_5.ZComponent, Center=Point(0, 0, 0), Axis=Z_2)  # -> Geometry, Transform; disabled
Z_3 = UnitZ(Factor=1)  # disabled
rot3d_6 = Rotate3D(Geometry=rot3d_4.Geometry, Angle=pdecon_5.ZComponent, Center=Point(0, 0, 0), Axis=Z_3)  # -> Geometry, Transform; disabled
rotax_2 = RotateAxis(Geometry=pt_8, Angle=degrees("90"), Axis=ln_2)  # -> Geometry, Transform
vdis = VectorDisplay(Anchor=Point(0, 0, 0), Vector=panel_3)  # disabled
vdis_2 = VectorDisplay(Anchor=Point(0, 0, 0), Vector=panel_5)  # disabled
vdis_3 = VectorDisplay(Anchor=Point(0, 0, 0), Vector=panel_6)  # disabled
pt_9 = Point(panel_4)  # disabled
pt_10 = Point(panel_7)  # disabled
pt_11 = Point(panel_8)  # disabled
pt_12 = Point(panel_9)  # disabled
pt_13 = Point(panel_10)  # disabled
vec2pt = Vector2Pt(PointA=Point(0, 0, 0), PointB=pt_8, Unitize=False)  # -> Vector, Length; disabled

# ---- group: camera taget line
move = Move(Geometry=rot3d_6.Geometry, Motion=vec2pt.Vector)  # -> Geometry, Transform; disabled

# ---- group: camera up line
move_2 = Move(Geometry=rot3d_5.Geometry, Motion=vec2pt.Vector)  # -> Geometry, Transform; disabled

# ----
ln_3 = Line(StartPoint="0,0,0", EndPoint="1,0,0")
number_slider = Slider(32, range=0..60)  # disabled
rotax_3 = RotateAxis(Angle=degrees("90"), Axis=ln_3)  # -> Geometry, Transform
end = EndPoints(Curve=move_2.Geometry)  # -> Start, End; disabled
toggle = BooleanToggle(False)  # disabled
end_2 = EndPoints(Curve=move.Geometry)  # -> Start, End; disabled
vec2pt_2 = Vector2Pt(PointA=end.Start, PointB=end.End, Unitize=False)  # -> Vector, Length; disabled
setcam = SetCamera(
    CameraLocation=end_2.Start,
    TargetLocation=end_2.End,
    LensLength=number_slider,
    UpDirection=vec2pt_2.Vector,
    Activate=toggle)  # disabled

# ---- group: cam1 pos
pt_14 = Point(Point(6239.727, -1172.106, 2909.551))

# ---- group: pic pixel w
panel_22 = Panel(panel)

# ----
camrotpitch = Slider(-39.545, range=-90..0)

# ---- group: pic pixel h
panel_23 = Panel(panel_2)

# ---- group: camFocalLengthX
panel_24 = Panel("1445.6323655009337")

# ----
camrotyaw = Slider(-53.561, range=-180..180)

# ---- group: draw cam ref
crv = Curve([<curve referenced from the Rhino model> x11])

# ----
camrotroll = Slider(0.994, range=-90..90)

# ---- group: draw cam ref
pt_15 = Point(<point referenced from the Rhino model>)

# ---- group: 4 world pts
# Galapagos Genetic Algorithm Solution (GH only)
pt_16 = Point(pt)

# ----
camposx = Slider(-871.632, range=-5000..15000)
camposz = Slider(2667.596, range=0..5000)
camposy = Slider(-1618.656, range=-5000..5000)

# ---- group: pic origin pt
pt_17 = Point(pt_2)

# ---- group: pic bound pt
pt_18 = Point(pt_3)

# ---- group: 4 pic pts
pt_19 = Point(pt_4)

# ----
xy = XYPlane(Origin=pt_15)

# ---- group: cam1 rot PRY
vec_2 = Vector(Vector(-38.147, -2.203, 46.003))

# ----
division = Division(A=panel_23, B=2)
division_2 = Division(A=panel_22, B=2)
subtraction = Subtraction(A=pt_19, B=pt_17)
xy_2 = XYPlane(Origin=Point(0, 0, 0))
neg = Negative(Value=division)
X_3 = UnitX(Factor=1)
neg_2 = Negative(Value=division_2)

# ---- group: cam2 pos
pt_20 = Point(Point(-871.632, -1618.656, 2667.596))

# ----
pdecon_6 = Deconstruct(Point=subtraction)  # -> XComponent, YComponent, ZComponent
line_3 = LineSDL(Start="0,0,0", Direction=X_3, Length=1)
pt_21 = ConstructPoint(XCoordinate=neg_2, YCoordinate=panel_24, ZCoordinate=neg)
Z_4 = UnitZ(Factor=1)

# ---- group: cam2 rot PRY
vec_3 = Vector(Vector(-39.545, 0.994, -53.561))

# ----
line_4 = LineSDL(Start="0,0,0", Direction=Z_4, Length=1)
xz = XZPlane(Origin=pt_21)
pt_22 = ConstructPoint(XCoordinate=camposx, YCoordinate=camposy, ZCoordinate=camposz)
vec_4 = VectorXYZ(XComponent=camrotpitch, YComponent=camrotroll, ZComponent=camrotyaw)  # -> Vector, Length

# ---- group: film plane_rh original
pln = Plane(xz)

# ---- group: cam pos
pt_23 = Point(pt_22)

# ---- group: cam rot PRY
vec_5 = Vector(vec_4.Vector)

# ----
xy_3 = XYPlane(Origin=Point(0, 0, 0))
vec2pt_3 = Vector2Pt(PointA="0,0,0", PointB=pt_23, Unitize=False)  # -> Vector, Length
galapagos = Galapagos(fitness=num, gene=[camposx, camposy, camposz, camrotpitch, camrotroll, camrotyaw])
devec = DeconstructVector(Vector=vec_5)  # -> XComponent, YComponent, ZComponent

# ---- group: pitch
rotax_4 = RotateAxis(Geometry=xy_2, Angle=degrees(devec.XComponent), Axis=line_3)  # -> Geometry, Transform

# ---- group: yaw
rotax_5 = RotateAxis(Geometry=rotax_4.Geometry, Angle=degrees(devec.ZComponent), Axis=line_4)  # -> Geometry, Transform

# ----
pt_24 = PointOriented(BasePlane=rotax_5.Geometry, UComponent=0, VComponent=100, WComponent=0)
ln_4 = Line(StartPoint="0,0,0", EndPoint=pt_24)

# ---- group: roll
rotax_6 = RotateAxis(Geometry=rotax_5.Geometry, Angle=degrees(devec.YComponent), Axis=ln_4)  # -> Geometry, Transform

# ----
move_3 = Move(Geometry=rotax_6.Geometry, Motion=vec2pt_3.Vector)  # -> Geometry, Transform

# ---- group: cam local xy plane
pln_2 = Plane(move_3.Geometry)

# ----
orient = Orient(Geometry=pln, Source=xy_3, Target=pln_2)  # -> Geometry, Transform

# ---- group: film plane_rh
pln_3 = Plane(orient.Geometry)

# ----
pt_25 = PointOriented(BasePlane=pln_3, UComponent=pdecon_6.XComponent, VComponent=pdecon_6.YComponent, WComponent=pdecon_6.ZComponent)
orient_2 = Orient(Geometry=crv, Source=xy, Target=pln_2)  # -> Geometry, Transform

# ---- group: 4 pts on film
pt_26 = Point(pt_25)

# ----
panel_25 = Panel("0,0,12")

# ---- group: draw cam
crv_2 = Curve(orient_2.Geometry)

# ----
panel_26 = Panel("99999")  # disabled
vec2pt_4 = Vector2Pt(PointA=pt_23, PointB=pt_26, Unitize=False)  # -> Vector, Length; disabled
xy_4 = XYPlane(Origin="0,0,0")
ln_5 = Line(StartPoint=pt_23, EndPoint=pt_26)
line_5 = LineSDL(Start=pt_23, Direction=vec2pt_4.Vector, Length=panel_26)  # disabled
plx = LinePlane(Line=ln_5, Plane=xy_4)  # -> Point, ParamL, ParamP
pcx = CurvePlane(Curve=line_5, Plane=xy_4)  # -> Points, ParamsC, ParamsP; disabled

# ---- group: intersection pts
pt_27 = Point(plx.Point)

# ----
dist = Distance(PointA=pt_27, PointB=pt_16)
ma = MassAddition(Input=dist)  # -> Result, PartialResults
pline = PolyLine(Vertices=pt_27, Closed=False)
ln_6 = Line(StartPoint=pt_23, EndPoint=pt_27)
pline_2 = PolyLine(Vertices=pt_26, Closed=False)

# ---- group: loss
num = Number(ma.Result)

# ---- group: on ground
preview = CustomPreview(Geometry=pline, Shader=ColourSwatch(SwatchColor=RGB(0, 255, 0)))

# ---- group: ray
preview_2 = CustomPreview(Geometry=ln_6, Shader=ColourSwatch(SwatchColor=RGB(199, 255, 199)))

# ---- group: on film
preview_3 = CustomPreview(Geometry=pline_2, Shader=ColourSwatch(SwatchColor=RGB(255, 0, 255)))

# ----
panel_27 = Panel(num)
